% Simulink data dictionary EVSE_Root_dict.sldd

Type2 = Simulink.Bus()  % * AC Charging
  % The IEC 62196-2 Type 1 connector is based on the SAE-J1772 standard, designed for single-phase alternating current from 6 to 32 A and thus allows charging power of up to 7.4 kW.
  % The IEC 62196-2 Type 2 connector was developed for three-phase alternating current up to 63 A, i.e. charging power up to 44 kW.
  % A single-phase charging process can also be carried out via the Type 2 connector, in this case the contact pins L2 and L3 are not used.
  % Therefore, it is easy to adapt between Type 1 and Type 2 plugs.
  % * DC Charging
  % The Combined Charging System (CCS) is the extension for the AC Type 1 and Type 2 plug for high DC charging ­capacities, which additionally has two large power contacts.
  % Just as in AC charging, the CP, PP and PE pins are also used, and the plug is expanded by positive and negative contacts.
  % For a high-level communication for smart charging, a power line ­communication (PLC) is overlaid on the CP.
  ACPhase2: double
  ACPhase1: double
  ACPhase3: double
  ACNeutral: double
  CP: double
  PE: double
  PP: double
  DC_P: double
  DN_N: double

Type1 = Simulink.Bus()  % * AC Charging
  % The IEC 62196-2 Type 1 connector is based on the SAE-J1772 standard, designed for single-phase alternating current from 6 to 32 A and thus allows charging power of up to 7.4 kW.
  % The IEC 62196-2 Type 2 connector was developed for three-phase alternating current up to 63 A, i.e. charging power up to 44 kW.
  % A single-phase charging process can also be carried out via the Type 2 connector, in this case the contact pins L2 and L3 are not used.
  % Therefore, it is easy to adapt between Type 1 and Type 2 plugs.
  % * DC Charging
  % The Combined Charging System (CCS) is the extension for the AC Type 1 and Type 2 plug for high DC charging ­capacities, which additionally has two large power contacts.
  % Just as in AC charging, the CP, PP and PE pins are also used, and the plug is expanded by positive and negative contacts.
  % For a high-level communication for smart charging, a power line ­communication (PLC) is overlaid on the CP.
  ACPhase1: double
  ACNeutral: double
  CP: double
  PE: double
  PP_CS_PD: double
  DC_P: double
  DC_N: double

GBT = Simulink.Bus()  % * AC Charging
  % GB/T 20234.2 enables both single- and three-phase charging in charging mode 3.
  % GB/T charging cables use identical male connectors similar to Type 2 on both ends.
  % * DC Charging
  % AC and DC charging plugs have different pins, which is why separate AC and DC inlets are required in the vehicle.
  % For DC charging, the communication protocol is defined by GB/T 27930.
  % It is used exclusively in China.
  CC: double
  PE: double
  CP: double
  N: double
  L3: double
  L2: double
  L1: double
  CAN_H: double
  PP: double
  CAN_L: double
  DC_N: double
  DC_P: double
  AuxP_N: double
  AuxP_P: double

CHAdeMO = Simulink.Bus()  % * AC Charging
  % * DC Charging
  % Similar to GB/T, CHAdeMO 2.0 uses CAN for the DC charging communication.
  % It is used in Japan and mainly by Japanese OEMs outside of Japan.
  DC_P: double
  DC_N: double
  PE: double
  ChargeSeq1: double
  ChargeSeq2: double
  CAN_H: double
  CAN_L: double
  PP: double
  ChargePerm: double

ChaoJi = Simulink.Bus()  % * AC Charging
  % * DC Charging
  % Unified charging system of GB and CHAdeMO. It offers ­charging with up to 900 kW.
  DC_P: double
  DC_N: double
  PE: double
  CAN_H: double
  CAN_L: double
  CC1: double
  CC2: double

MCS = Simulink.Bus()  % * AC Charging
  % << No support >>
  % * DC Charging
  % The Megawatt Charging System (MCS) is designed for DC charging in the range of 3.75 MW of large battery EVs like ­heavy-duty vehicles.
  % There are two ­separate ­communication ­lines independent from CP and PP.
  % The communication and basic concept are based on ISO 15118-20 with a different ­connector.
  % There is no PWM ­communication according to IEC 61851 preceding the high-level ­communication according to ISO 15118.
  % Cooling is necessary.
  DC_P: double
  DC_N: double
  Comm: double
  PP: double
  PE: double
  CP: double

NACS = Simulink.Bus()  % * AC Charging
  % A Tesla is charged with AC or DC superchargers and in the EU with a three-phase AC Type 2 charger.
  % * DC Charging
  % The Tesla Supercharger uses a proprietary communication protocol. In the EU,
  % Tesla uses the CCS Type 2 connector face, because of the 2014/94 EU directive.
  Power1: double
  Power2: double
  CP: double
  PP: double
  PE: double